# Grasshopper definition mobile_robot_workspace_only_ROS.ghx (Grasshopper 1.0.7)

# ---- group: ROS client
# Test Cylinder
disconnect = Button()
connect = Button()
connect_2 = PythonScript(ip="192.168.0.40", connect=connect, disconnect=disconnect)  # -> out, ros_client
# ---------- connect_2: Python ----------
import sys
import scriptcontext as sc
from compas_fab.backends import RosClient

key = 'rosclient_%s' % str(ghenv.Component.InstanceGuid)
previous_client = sc.sticky.get(key, None)

if previous_client and (connect or disconnect):
    previous_client.close()

if connect:
    ros_client = RosClient(ip, 9090)
    sc.sticky[key] = ros_client
    ros_client.run(5)

ros_client = sc.sticky.get(key, None)
print('ROS connected: {}'.format(ros_client.is_connected if ros_client else 'False'))
# ---------- end connect_2 ----------
is_connected = Panel(connect_2.out)

# ----
# Global Localization
# Subscribe to topics
toggle = BooleanToggle(True)
subscriber = GhPythonScript(
    ros_client=connect_2.ros_client,
    subscribe_to_robot_lift_topic=toggle,
    subscribe_to_robotnik_base_topic=toggle,
    subscribe_to_static_tf_topic=toggle)  # -> out
# ---------- subscriber: Python ----------
import time
import logging
import datetime
import Grasshopper
from roslibpy import Topic
from scriptcontext import sticky

LOGGER = logging.getLogger('roslibpy')

robot_lift_pos = 'listener_robot_lift_pos'
robot_base_footprint = 'listener_robot_base_footprint'
tf_static = 'listener_tf_static'

if subscribe_to_robot_lift_topic:
    if ros_client and ros_client.is_connected:
        print("subscribed to /robot/ewellix_driver/lift/pos topic")
        listener = Topic(ros_client, '/robot/ewellix_driver/lift/pos', 'std_msgs/Float64')
        sticky[robot_lift_pos] = listener
    else:
        sticky[robot_lift_pos] = None
        print("NOT subscribed to /robot/ewellix_driver/lift/pos topic")
else:
    sticky[robot_lift_pos] = None

if subscribe_to_robotnik_base_topic:
    if ros_client and ros_client.is_connected:
        print("subscribed to /robot/robotnik_base_control/odom topic")
        listener = Topic(ros_client, '/robot/robotnik_base_control/odom', 'nav_msgs/Odometry')
        sticky[robot_base_footprint] = listener
    else:
        sticky[robot_base_footprint] = None
        print("NOT subscribed to /robot/robotnik_base_control/odom topic")
else:
    sticky[robot_base_footprint] = None

if subscribe_to_static_tf_topic:
    if ros_client and ros_client.is_connected:
        print("subscribed to /tf_static topic")
        listener = Topic(ros_client, '/tf_static', 'tf2_msgs/TFMessage')
        sticky[tf_static] = listener
        #print sticky[tf_static]
    else:
        sticky[tf_static] = None
        print("NOT subscribed to /tf_static topic")
else:
    sticky[tf_static] = None
# ---------- end subscriber ----------
panel = Panel(subscriber)

# ----
# Listen to topics
start_timer = Button()
stop_timer = Button()
bang = Button()
listener = GhPythonScript(bang=bang, start_timer=start_timer, stop_timer=stop_timer)  # -> out, T_static, mobile_base_roscf, ur_roscf, lift_pos, mobile_base_roscp, ur_roscp
# ---------- listener: Python ----------
from scriptcontext import sticky
from compas_ghpython.utilities import update_component
from compas.geometry import Frame, Transformation, Translation, Point, Rotation, Vector
from compas_ghpython import draw_frame
import Rhino.Geometry as rg
import math

guid = str(ghenv.Component.InstanceGuid)
timer_running_key = "timer_running_" + guid
counter_key = "counter_" + guid

robot_lift_length = 0.533

if stop_timer or timer_running_key not in sticky:
    sticky[timer_running_key] = False
    sticky[counter_key] = 0

if start_timer:
    sticky[timer_running_key] = True
    sticky[counter_key] = 0
    

if sticky[timer_running_key]:
    update_component(ghenv, 1000)
    
    sticky[counter_key] += 1
    print(sticky[counter_key])


def receive_message_tf_static(message):
    #sticky['message'] = str(datetime.datetime.now()) + ': ' + str(message)
    #print("receiving")
    sticky['ros_msg_tf_static'] = message
    
def receive_message_robot_footprint(message):
    #sticky['message'] = str(datetime.datetime.now()) + ': ' + str(message)
    #print("receiving")
    sticky['ros_msg_robot_footprint'] = message

def receive_message_robot_lift_pos(message):
    #sticky['message'] = str(datetime.datetime.now()) + ': ' + str(message)
    #print("receiving")
    sticky['ros_msg_robot_lift_pos'] = message


if 'listener_robot_base_footprint' in sticky:
    if sticky['listener_robot_base_footprint']:
    
        listener_robot_base_footprint = sticky['listener_robot_base_footprint']
        listener_robot_base_footprint.subscribe(receive_message_robot_footprint)
    
        if 'ros_msg_robot_footprint' in sticky and sticky['ros_msg_robot_footprint']:
            #bang = True
            
            ros_msg_robot_footprint = sticky['ros_msg_robot_footprint']
            if len(ros_msg_robot_footprint):
                robot_base_footprint = ros_msg_robot_footprint
                p = robot_base_footprint['pose']['pose']
                #print('robot_base_footprint', p)
                mobile_base_roscf = Frame.from_quaternion([p['orientation']['w'],p['orientation']['x'], p['orientation']['y'], p['orientation']['z']], point = [p['position']['x'], p['position']['y'], p['position']['z']])

                mobile_base_roscp = draw_frame(mobile_base_roscf)
                print('++ Listening to ROS MSG ROBOT BASE FOOTPRINT')
                
        else:
            bang = False
            print('NOT receiving ROS MSG ROBOT BASE FOOTPRINT')
    else:
        print('NOT receiving ROS MSG ROBOT BASE FOOTPRINT')


if 'listener_tf_static' in sticky:
    if sticky['listener_tf_static']:
    
        listener_tf_static = sticky['listener_tf_static']
        listener_tf_static.subscribe(receive_message_tf_static)
    
        if 'ros_msg_tf_static' in sticky and sticky['ros_msg_tf_static']:
            #bang = True
            
            ros_msg_tf_static = sticky['ros_msg_tf_static']
            if len(ros_msg_tf_static and ros_msg_tf_static['transforms']):
                
                ### First static transformation from mobile robot base frame to mobile robot base link
                tf0 = ros_msg_tf_static['transforms'][0]
                t0 = tf0['transform']
                #print('robot_base frame to robot_base_link', t0)
                x1, y1, z1 = t0['translation']['x'], t0['translation']['y'], t0['translation']['z']
                
                ## Second static transformation from mobile robot base link to ewellix base link
                tf1 = ros_msg_tf_static['transforms'][2]
                t1 = tf1['transform']
                #print('robot_base_link to ewellix_base_link', t1)
                x2, y2, z2 = t1['translation']['x'], t1['translation']['y'], t1['translation']['z']
                
                print('++ Listening to ROS MSG TF STATIC')

                ## Translations in x, y, z axis from the received static transformations
                T1 = Translation.from_vector(mobile_base_roscf.xaxis*(x1+x2))
                T2 = Translation.from_vector(mobile_base_roscf.yaxis*(y1+y2))
                T3 = Translation.from_vector(mobile_base_roscf.zaxis*(z1+z2))

                T_rbl_ebl = T1*T2*T3
                
                ewellix_base_roscf = mobile_base_roscf.transformed(T_rbl_ebl)
                ewellix_base_roscp = draw_frame(ewellix_base_roscf)
        else:
            bang = False
            print('NOT receiving ROS MSG TF STATIC')
    else:
        print('NOT receiving ROS MSG TF STATIC')


if 'listener_robot_lift_pos' in sticky:
    if sticky['listener_robot_lift_pos']:
    
        listener_robot_lift_pos = sticky['listener_robot_lift_pos']
        listener_robot_lift_pos.subscribe(receive_message_robot_lift_pos)
    
        if 'ros_msg_robot_lift_pos' in sticky and sticky['ros_msg_robot_lift_pos']:
            #bang = True
            
            ros_msg_robot_lift_pos = sticky['ros_msg_robot_lift_pos']
            if len(ros_msg_robot_lift_pos):
                lift_pos = ros_msg_robot_lift_pos['data']
                T_ebl_etl = Transformation.from_frame(Frame.from_quaternion([1.0,0.0,0.0,0.0], point=[0.0,0.0,robot_lift_length + lift_pos]))
                T_static = T_rbl_ebl*T_ebl_etl
                ur_roscf = ewellix_base_roscf.transformed(T_ebl_etl)
                R = Rotation.from_axis_and_angle(ur_roscf.zaxis, math.radians(135), point=ur_roscf.point)
                ur_roscf.transform(R)
                #print(ur_roscf)
                ur_roscp = draw_frame(ur_roscf)
                print('++ Listening to ROS MSG ROBOT LIFT POSITION')
                
        else:
            bang = False
            print('NOT receiving ROS MSG ROBOT LIFT POSITION')
    else:
        print('NOT receiving ROS MSG ROBOT LIFT POSITION')
        
#bang = True if bang else False
# ---------- end listener ----------
panel_2 = Panel(listener.out)
t_static = Data(listener.T_static)
panel_3 = Panel(listener.lift_pos)
draw = GhPythonScript(frames=listener.ur_roscf, scale=Slider(0.1, range=0..1))  # -> P, V, C, W; inputs frames: list
# ---------- draw: Python ----------
from System.Drawing import Color
from compas_ghpython.utilities import draw_frame

red = Color.FromArgb(255, 0, 0)
green = Color.FromArgb(0, 255, 0)
blue = Color.FromArgb(0, 0, 255)

P = []
V = []
C = []

scale = float(scale)

for frame in frames:
    if not frame:
        continue
    plane = draw_frame(frame)
    P += [plane.Origin] * 3
    V.append(plane.XAxis * scale)
    V.append(plane.YAxis * scale)
    V.append(plane.ZAxis * scale)
    C += [red, green, blue]

W = 3
# ---------- end draw ----------
vdisex = VectorDisplayEx(Point=draw.P, Vector=draw.V, Colour=draw.C, Width=draw.W)

mobile_base_roscp = Plane(listener.mobile_base_roscp)
# A_00
mobile_base_roscp_2 = Plane(Plane(origin=(0.03464802113, 0.1535078806, 0), x=(0.9993857225, -0.03504536484, 0), y=(0.03504536484, 0.9993857225, 0)))
# B_00
# C_00
# D_00
ur_roscp = Plane(Plane(origin=(0.3144760234, 0.1436951784, 1.086838298), x=(-0.6818916063, 0.7314532366, 0), y=(-0.7314532366, -0.6818916063, 0)))

# ----
# Transform RosCF to WCF
t_roscf_wcf = Data("Grasshopper.Kernel.Types.GH_ObjectWrapper")
python = GhPythonScript(T_roscf_wcf=t_roscf_wcf, ur_roscf=listener.ur_roscf, mobile_base_roscf=listener.mobile_base_roscf)  # -> out, ur_base_frame, mobile_base_frame, ur_base_plane, mobile_base_plane
# ---------- python: Python ----------
import rhinoscriptsyntax as rs
from compas.geometry import Transformation
from compas_ghpython import draw_frame

#T_roscf_wcf = Transformation.from_matrix([[   -0.5194,   -0.8545,   -0.0086,    0.3153],
# [    0.8545,   -0.5193,   -0.0089,   -1.0937],
# [    0.0031,   -0.0120,    0.9999,   -0.1716],
# [    0.0000,    0.0000,    0.0000,    1.0000]])


if ur_roscf:
    ur_base_frame = ur_roscf.transformed(T_roscf_wcf)
    mobile_base_frame = mobile_base_roscf.transformed(T_roscf_wcf)
    ur_base_plane = draw_frame(ur_base_frame)
    mobile_base_plane = draw_frame(mobile_base_frame)
    print(ur_base_plane)

else:
    print('NO ROS Base Coordinate Frame received')
# ---------- end python ----------
panel_4 = Panel(python.out)

ur_roscp_2 = Plane(listener.ur_roscp)
transformations = GhPythonScript(T_roscf_wcf=t_roscf_wcf)  # -> T_roscf_wcf, T_static, T_local; unedited script template

# ----
# Global_T
panel_5 = Panel("""[[   -0.5333,    0.8458,   -0.0117,    0.5758],
 [   -0.8457,   -0.5335,   -0.0128,    1.1788],
 [   -0.0171,    0.0031,    0.9998,   -0.1436],
 [    0.0000,    0.0000,    0.0000,    1.0000]]""")
# E_00
# F_00
panel_6 = Panel("""[[   -0.5333,    0.8458,   -0.0117,    0.5758],
 [   -0.8457,   -0.5335,   -0.0128,    1.1788],
 [   -0.0171,    0.0031,    0.9998,   -0.1436],
 [    0.0000,    0.0000,    0.0000,    1.0000]]""")

# ----
# RosCF to WCF Transformation
# Calculate Basis - Point fitting method via RPC
toggle_2 = BooleanToggle(False)
base_plane_wcs = Plane(Plane(origin=(0.516823, 0.822235, 0.938186), x=(0.9823590056, 0.1864850011, 0.01393300008), y=(-0.1866353088, 0.9823742907, 0.0103930001)))
rcf_to_wcf = GhPythonScript(ur_wcp=base_plane_wcs, ur_roscf=listener.ur_roscf, calculate=toggle_2)  # -> out, T_roscf_wcf, T_wcf_rcf
# ---------- rcf_to_wcf: Python ----------
from compas.geometry import Frame, Transformation
from compas_ghpython import draw_frame
from scriptcontext import sticky


if calculate:
    if ur_roscf:
        
        if ur_wcp:
            ur_wcf = Frame(ur_wcp.Origin, ur_wcp.XAxis, ur_wcp.YAxis)
            
            T_roscf_wcf = Transformation.from_frame_to_frame(ur_roscf, ur_wcf)
            #T_wcf_rcf = Transformation.from_frame_to_frame(ur_wcf, ur_roscf)
            sticky['t_global'] = T_roscf_wcf
            
            print('++ RCF received from ROS')
            print(T_roscf_wcf)
        
        else:
            print('++ NO WCF provided')
            sticky['t_global'] = None
        
    else:
        print('++ NOT receiving RCF')
        sticky['t_global'] = None
        
else:
    print('++ LAST TRANSFORMATION')
    
    T_roscf_wcf = sticky['t_global']
    print(T_roscf_wcf)
# ---------- end rcf_to_wcf ----------
panel_7 = Panel(rcf_to_wcf.out)
t_roscf_wcf_2 = Data(rcf_to_wcf.T_roscf_wcf)

ur_base_plane = Plane(python.ur_base_plane)
mobile_base_plane = Plane(python.mobile_base_plane)
ur_base_plane_2 = Plane(Plane(origin=(0.516823, 0.822235, 0.938186), x=(0.9823590056, 0.1864850011, 0.01393300008), y=(-0.1866353088, 0.9823742907, 0.0103930001)))
mobile_base_plane_2 = Plane(Plane(origin=(0.6871378243, 1.067579783, -0.1436717929), x=(-0.562661622, -0.8265083315, -0.01720107968), y=(0.8266038069, -0.5627787138, 0.002503157993)))
# Points measured
a_00 = Point([Point(-0.1485, 0.3425511777, 0), Point(-0.0485, 0.3425511777, 0), Point(0.0515, 0.3425511777, 0), Point(0.1515, 0.3425511777, 0), Point(0.222408022, 0.2998803613, 0), Point(0.272408022, 0.2132778209, 0), Point(0.322408022, 0.1266752805, 0), Point(0.372408022, 0.04007274016, 0)])
b_00 = Point([Point(-0.220908022, 0.3024784375, 0), Point(-0.270908022, 0.2158758971, 0), Point(-0.320908022, 0.1292733567, 0), Point(-0.370908022, 0.04267081637, 0), Point(-0.372408022, -0.04007274016, 0), Point(-0.322408022, -0.1266752805, 0), Point(-0.272408022, -0.2132778209, 0), Point(-0.222408022, -0.2998803613, 0)])
c_00 = Point([Point(-0.1515, -0.3425511777, 0), Point(-0.0515, -0.3425511777, 0), Point(0.0485, -0.3425511777, 0), Point(0.1485, -0.3425511777, 0), Point(0.220908022, -0.3024784375, 0), Point(0.270908022, -0.2158758971, 0), Point(0.320908022, -0.1292733567, 0), Point(0.370908022, -0.04267081637, 0)])
d_00 = Point([Point(0.220908022, -0.3024784375, 0), Point(0.270908022, -0.2158758971, 0), Point(0.320908022, -0.1292733567, 0), Point(0.370908022, -0.04267081637, 0), Point(0.372408022, 0.04007274016, 0), Point(0.322408022, 0.1266752805, 0), Point(0.272408022, 0.2132778209, 0), Point(0.222408022, 0.2998803613, 0)])
e_00 = Point([Point(0.1515, 0.3425511777, 0), Point(0.0515, 0.3425511777, 0), Point(-0.0485, 0.3425511777, 0), Point(-0.1485, 0.3425511777, 0), Point(-0.220908022, 0.3024784375, 0), Point(-0.270908022, 0.2158758971, 0), Point(-0.320908022, 0.1292733567, 0), Point(-0.370908022, 0.04267081637, 0)])
f_00 = Point([Point(-0.372408022, -0.04007274016, 0), Point(-0.322408022, -0.1266752805, 0), Point(-0.272408022, -0.2132778209, 0), Point(-0.222408022, -0.2998803613, 0), Point(-0.1515, -0.3425511777, 0), Point(-0.0515, -0.3425511777, 0), Point(0.0485, -0.3425511777, 0), Point(0.1485, -0.3425511777, 0)])

# ----
# Adjust rotation and/or position of base plane initial guess!
crv = Curve(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)
# Local Localization
pt = Point(Point(0.518794138, 0.8235482912, 0.932975))
crv_2 = Curve(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)
init_gues = ConstructPlane(Origin=pt, XAxis=crv_2, YAxis=crv)

# ----
# Local Transformation (relative to workpiece)
# Calculate Basis - Point fitting method via RPC
a_00_2 = Point([Point(-0.1485, 0.3425511777, 0), Point(-0.0485, 0.3425511777, 0), Point(0.0515, 0.3425511777, 0), Point(0.1515, 0.3425511777, 0), Point(0.222408022, 0.2998803613, 0), Point(0.272408022, 0.2132778209, 0), Point(0.322408022, 0.1266752805, 0), Point(0.372408022, 0.04007274016, 0)])
b_00_2 = Point([Point(-0.220908022, 0.3024784375, 0), Point(-0.270908022, 0.2158758971, 0), Point(-0.320908022, 0.1292733567, 0), Point(-0.370908022, 0.04267081637, 0), Point(-0.372408022, -0.04007274016, 0), Point(-0.322408022, -0.1266752805, 0), Point(-0.272408022, -0.2132778209, 0), Point(-0.222408022, -0.2998803613, 0)])
c_00_2 = Point([Point(-0.1515, -0.3425511777, 0), Point(-0.0515, -0.3425511777, 0), Point(0.0485, -0.3425511777, 0), Point(0.1485, -0.3425511777, 0), Point(0.220908022, -0.3024784375, 0), Point(0.270908022, -0.2158758971, 0), Point(0.320908022, -0.1292733567, 0), Point(0.370908022, -0.04267081637, 0)])
d_00_2 = Point([Point(0.220908022, -0.3024784375, 0), Point(0.270908022, -0.2158758971, 0), Point(0.320908022, -0.1292733567, 0), Point(0.370908022, -0.04267081637, 0), Point(0.372408022, 0.04007274016, 0), Point(0.322408022, 0.1266752805, 0), Point(0.272408022, 0.2132778209, 0), Point(0.222408022, 0.2998803613, 0)])
e_00_2 = Point([Point(0.1515, 0.3425511777, 0), Point(0.0515, 0.3425511777, 0), Point(-0.0485, 0.3425511777, 0), Point(-0.1485, 0.3425511777, 0), Point(-0.220908022, 0.3024784375, 0), Point(-0.270908022, 0.2158758971, 0), Point(-0.320908022, 0.1292733567, 0), Point(-0.370908022, 0.04267081637, 0)])
f_00_2 = Point([Point(-0.372408022, -0.04007274016, 0), Point(-0.322408022, -0.1266752805, 0), Point(-0.272408022, -0.2132778209, 0), Point(-0.222408022, -0.2998803613, 0), Point(-0.1515, -0.3425511777, 0), Point(-0.0515, -0.3425511777, 0), Point(0.0485, -0.3425511777, 0), Point(0.1485, -0.3425511777, 0)])
calc_base = PythonScript(pts_cad=b_00_2, base_plane_init_guess=init_gues, calc=Toggle(False))  # -> out, pts_mtip_init_guess, pts_mtip_fit, base_plane_fit; inputs poses: list, pts_cad: list of Point3d, base_plane_init_guess: Plane
# ---------- calc_base: Python ----------
import ghpythonlib.components as ghcomp
import Rhino.Geometry as rg
from scriptcontext import sticky as st
from compas.geometry import Frame
import math as m
import sys
from compas.rpc import Proxy # for calling the numpy function in CPython

#poses = [[-0.38248900000000002, -0.65991, -0.92396800000000001, 1.43926, -2.33921, -0.356576], [-0.40332200000000001, -0.561226, -0.92589100000000002, 1.39317, -2.5024600000000001, -0.45355000000000001], [-0.42333500000000002, -0.46363100000000002, -0.92523200000000005, 1.32002, -2.7929300000000001, -0.42181200000000002], [-0.44414100000000001, -0.364207, -0.92577699999999996, -1.1245799999999999, 2.7569599999999999, 0.54737599999999997], [-0.49800100000000003, -0.303369, -0.92580499999999999, -0.97646200000000005, 2.8092899999999998, 0.66510199999999997], [-0.59415899999999999, -0.27221099999999998, -0.92597399999999996, 0.74782499999999996, -2.8146399999999998, -0.69757899999999995], [-0.69017399999999995, -0.24166299999999999, -0.924068, 0.51681200000000005, -2.6232899999999999, -0.79130500000000004], [-0.78496699999999997, -0.21047299999999999, -0.92393599999999998, 0.396513, -2.6047699999999998, -0.78313699999999997]]

if len(poses):
    
    # get points from poses
    pts_mtip = [rg.Point3d(p[0], p[1], p[2]) for p in poses]
    
    T_W_R_init_guess = rg.Transform.PlaneToPlane(rg.Plane.WorldXY, base_plane_init_guess)
    pts_mtip_init_guess = [ghcomp.Transform(pt, T_W_R_init_guess) for pt in pts_mtip]
    
    # format Rhino transformation
    T_W_R_init_guess_flattened = [float(f) for f in T_W_R_init_guess.ToFloatArray(True)]
    T_W_R_init_guess_list = [T_W_R_init_guess_flattened[i:(i + 4)] for i in range(0, len(T_W_R_init_guess_flattened), 4)]  

    # format ptsA and ptsB
    dataB = [list(pt) for pt in pts_cad]
    dataA = [list(pt) for pt in pts_mtip]
    
    # call the function
    max_iterations = 1000
    
    if calc:
        icp_func = Proxy('ur_fabrication_control.optimisation.icp', python = 'C://Users//lidet//anaconda3//envs//learn//python.exe')
        
        print icp_func._python

        transformation, distances = icp_func.icp(dataA, dataB, init_guess=T_W_R_init_guess_list, max_iterations=max_iterations, tolerance=0.000001)
        
        print "distances", distances
        
        # format result
        T = rg.Transform.Identity
        for i in range(4):
            for j in range(4):
                code = "T.M%i%i = %f" % (i, j, transformation[i][j])
                print code
                exec(code)
        #print T
        
        # now transform the points with the transformation calculated
        pts_mtip_fit = [ghcomp.Transform(pt, T) for pt in pts_mtip]
        base_plane_fit = ghcomp.Transform(rg.Plane.WorldXY, T)
        
        
        #f = Frame(base_plane_fit)
        #print f.get_pose_quaternion()
        
        # correct the zvalue
        #base_plane_fit = ghcomp.Transform(base_plane_fit, rg.Transform.Translation(0,0,-3))
# ---------- end calc_base ----------
panel_8 = Panel(calc_base.out)
pt_2 = Point(calc_base.pts_mtip_init_guess)
pt_3 = Point(calc_base.pts_mtip_fit)
pln = Plane(calc_base.base_plane_fit)

# ----
# Point Fit
pt_4 = Point([Point(-0.1480125653, 0.341845139, 0.000438091886), Point(-0.04694096673, 0.341731424, -0.00030795892), Point(0.05266329217, 0.3421717936, -0.000686096447), Point(0.1513693391, 0.3424420487, 0.000521273173), Point(0.2216640755, 0.3014983611, 0.000571702921), Point(0.2718125532, 0.2139081364, -0.000689313922), Point(0.3214406397, 0.1266995872, -0.000225294949), Point(0.3716309203, 0.03981731289, 0.000373529376)])

# ----
# Labels
pt_5 = Point([Point(0.298708097, 0.5173776006, 0), Point(-0.597416194, 0, 0), Point(0.298708097, -0.5173776006, 0), Point(0.597416194, 0, 0), Point(-0.298708097, 0.5173776006, 0), Point(-0.298708097, -0.5173776006, 0)])
python_2 = GhPythonScript(pts=pt_5)  # -> out, pts, labels; inputs pts: list
# ---------- python_2: Python ----------
import rhinoscriptsyntax as rs

labels = ['A','B','C','D','E','F']
# ---------- end python_2 ----------
tag = TextTag3D(Location=python_2.pts, Text=python_2.labels, Size=Slider(0.1, range=0..1), Colour=RGB(0, 0, 0), Justification=5)

# ----
# Point Record
number_slider = Slider(0, range=0..20)
add = Button()
list = ValueList({"A", "B", "C", "D", "E", "F"}, selected="A")
pt_6 = Point(a_00_2)
python_3 = GhPythonScript(segment=list, layer=number_slider, pts=pt_6, add=add, show_record=Toggle(True))  # -> out, point_record; inputs layer: Int32, pts: list
# ---------- python_3: Python ----------
import rhinoscriptsyntax as rs
import os

repositories_path = os.path.abspath(os.path.join(ghdoc.Path,"../../../"))
filepath = os.path.abspath(os.path.join(ghdoc.Path,"../../../mobile_fabrication_control/data/points_record.txt"))

points = {}
points_list =[]


segment_id = '{0}{1}{2}'.format(segment, '_0', str(layer))

print segment_id

if pts:
    for p in pts:
        pt = rs.coerce3dpoint(p)
        points_list.append([pt.X, pt.Y, pt.Z])
    
    points[segment_id] = points_list
    
    if add:
        f = open(filepath, "a")
        f.write((str(points) + "\n" + "\n"))
        f.close()
    
    if show_record:
        f = open(filepath, "r")
        point_record=f.read()
# ---------- end python_3 ----------
point_record = Panel(python_3.point_record)
segment_id = Panel(python_3.out)
